# Dynamo graph CreateBoardByPreset.dyn (Dynamo 2.3.0.5885)

string = StringInput("CreateBoardByPreset.py")  # graph input
file_from_path = FileObject(path=string)
readText = FileSystem.ReadText(file=file_from_path)
reload = BoolSelector(true)
select_model_element = DSModelElementSelection()  # 1 picked in the model
presets = CodeBlock { "2R_main"; "2R_sub"; }
python_script_from_string = PythonStringNode(script=readText, IN[0]=file_from_path, IN[1]=reload, IN[2]=select_model_element, IN[3]=presets.out0)
