# Dynamo graph PrintPDF.dyn (Dynamo 2.16.1.2727)

string = StringInput("get_local_printers.py")  # graph input; frozen
file_from_path = FileObject(path=string)
readText = FileSystem.ReadText(file=file_from_path)

# group: Reload
# Reload
reload = BoolSelector(true)  # frozen

python_script_from_string = PythonStringNode(script=readText, IN[0]=file_from_path, IN[1]=reload)  # CPython3
code_block = CodeBlock(Printer=python_script_from_string) { Printer[5]; }
string_2 = StringInput("PrintPDF.py")  # graph input
file_from_path_2 = FileObject(path=string_2)
readText_2 = FileSystem.ReadText(file=file_from_path_2)

# group: Reload
# Reload
reload_2 = BoolSelector(false)

code_block_2 = CodeBlock { "PDFCreator"; }
directory_path = StringInput("C:\05 TEMP\PrintTest")  # graph input
sheets = Sheets("Legends")
python_script_from_string_2 = PythonStringNode(script=readText_2, IN[0]=file_from_path_2, IN[1]=reload_2, IN[2]=code_block_2, IN[3]=directory_path, IN[4]=sheets)  # CPython3
code_block_3 = CodeBlock { "PDF24"; }
